# Dynamo graph Design Automation sample .dyn "GD 찍먹 건축 Sample 2 2d to 3D" (Dynamo 2.16.1.2727)

# group: 사각형 공간 크기 인풋
W1 = DoubleSlider(6000, range=5000..20000 step 1000)  # graph input
L1 = DoubleSlider(8000, range=5000..20000 step 1000)  # graph input
W2 = DoubleSlider(14000, range=5000..20000 step 1000)  # graph input
L2 = DoubleSlider(18000, range=5000..20000 step 1000)  # graph input
W3 = DoubleSlider(14000, range=5000..20000 step 1000)  # graph input
L3 = DoubleSlider(12000, range=5000..20000 step 1000)  # graph input
W4 = DoubleSlider(14000, range=5000..20000 step 1000)  # graph input
L4 = DoubleSlider(5000, range=5000..20000 step 1000)  # graph input

# group: 사각형 공간 생성
byWidthLength = Rectangle.ByWidthLength(width=W1, length=L1)
byPatch = Surface.ByPatch(closedCurve=byWidthLength)
byWidthLength_2 = Rectangle.ByWidthLength(width=W2, length=L2)
byPatch_2 = Surface.ByPatch(closedCurve=byWidthLength_2)
byWidthLength_3 = Rectangle.ByWidthLength(width=W3, length=L3)
byPatch_3 = Surface.ByPatch(closedCurve=byWidthLength_3)
byWidthLength_4 = Rectangle.ByWidthLength(width=W4, length=L4)
byPatch_4 = Surface.ByPatch(closedCurve=byWidthLength_4)

# group: 대지 형태 POINT 20M X 20M
number_slider = DoubleSlider(0, range=-1944.932..100 step 0.1)
number_slider_2 = DoubleSlider(0, range=-3506.534..100 step 0.1)
byCoordinates = Point.ByCoordinates(x=number_slider, y=number_slider_2)
number_slider_3 = DoubleSlider(30000, range=0..30000 step 0.1)
number_slider_4 = DoubleSlider(0, range=-1538.295..100 step 0.1)
byCoordinates_2 = Point.ByCoordinates(x=number_slider_3, y=number_slider_4)
number_slider_5 = DoubleSlider(30000, range=-2528.044..30000 step 0.1)
number_slider_6 = DoubleSlider(30000, range=0..30000 step 0.1)
byCoordinates_3 = Point.ByCoordinates(x=number_slider_5, y=number_slider_6)
number_slider_7 = DoubleSlider(0, range=0..5284.5 step 0.1)
number_slider_8 = DoubleSlider(30000, range=0..30000 step 0.1)
byCoordinates_4 = Point.ByCoordinates(x=number_slider_7, y=number_slider_8)
join = List.Join(list0=byCoordinates, list1=byCoordinates_2, list2=byCoordinates_3, list3=byCoordinates_4)
watch = Watch(join)

# group: 대지경계선
boolean = BoolSelector(true)
byPoints = PolyCurve.ByPoints(points=join, connectLastToFirst=boolean)
byPatch_5 = Surface.ByPatch(closedCurve=byPoints)

# group: 건축 한계선
code_block = CodeBlock { -500; }
offsetMany = Curve.OffsetMany(curve=byPoints, signedDistance=code_block)

# group: 대지 형태 유지
byPatch_6 = Surface.ByPatch(closedCurve=offsetMany)

# group: 도로 모퉁이 교차점 확인
number_slider_9 = DoubleSlider(-1000, range=-1000..5284.5 step 0.1)
number_slider_10 = DoubleSlider(21000, range=0..21000 step 0.1)
byCoordinates_5 = Point.ByCoordinates(x=number_slider_9, y=number_slider_10)
byStartPointEndPoint = Line.ByStartPointEndPoint(startPoint=byCoordinates_5, endPoint=watch)
length = Curve.Length()  # unwired: curve
sortByFunction = List.SortByFunction(list=byStartPointEndPoint, sortFunction=length)
firstItem = List.FirstItem(list=sortByFunction)
number_slider_11 = DoubleSlider(21000, range=-2528.044..21000 step 0.1)
number_slider_12 = DoubleSlider(21000, range=0..21000 step 0.1)
byCoordinates_6 = Point.ByCoordinates(x=number_slider_11, y=number_slider_12)
byStartPointEndPoint_2 = Line.ByStartPointEndPoint(startPoint=byCoordinates_6, endPoint=watch)
length_2 = Curve.Length()  # unwired: curve
sortByFunction_2 = List.SortByFunction(list=byStartPointEndPoint_2, sortFunction=length_2)
firstItem_2 = List.FirstItem(list=sortByFunction_2)

# group: 도로 모퉁이 교차점에서 2M 후퇴 형상 추출
watch_2 = Watch(byPoints)
intersect = Geometry.Intersect(geometry=firstItem, other=watch_2)
code_block_2 = CodeBlock { 2000; }
byCenterPointRadius = Circle.ByCenterPointRadius(centerPoint=intersect, radius=code_block_2)
intersect_2 = Geometry.Intersect(geometry=byCenterPointRadius, other=watch_2)
flatten = List.Flatten(list=intersect_2)
join_2 = List.Join(list0=intersect, list1=flatten)
byPoints_2 = Polygon.ByPoints(points=join_2)
byPatch_7 = Surface.ByPatch(closedCurve=byPoints_2)
intersect_3 = Geometry.Intersect(geometry=firstItem_2, other=watch_2)
byCenterPointRadius_2 = Circle.ByCenterPointRadius(centerPoint=intersect_3, radius=code_block_2)
intersect_4 = Geometry.Intersect(geometry=byCenterPointRadius_2, other=watch_2)
flatten_2 = List.Flatten(list=intersect_4)
join_3 = List.Join(list0=intersect_3, list1=flatten_2)
byPoints_3 = Polygon.ByPoints(points=join_3)
byPatch_8 = Surface.ByPatch(closedCurve=byPoints_3)
join_4 = List.Join(list0=byPatch_7, list1=byPatch_8)
byJoinedSurfaces = PolySurface.ByJoinedSurfaces(surfaces=join_4)
difference = Surface.Difference(surface=byPatch_6, others=byJoinedSurfaces)

# group: 건축 가능 영역 내부 형태 배치를 위한 포인트 추출
watch_3 = Watch(byPatch_6)
code_block_3 = CodeBlock { 0..1..0.05; }
pointAtParameter = Surface.PointAtParameter(surface=watch_3, u=code_block_3, v=code_block_3, lacing=CrossProduct)
intersect_5 = Geometry.Intersect(geometry=difference, other=pointAtParameter)

# group: 배치 변수
변수1 = DoubleSlider(12, range=0..121 step 1)  # graph input
변수2 = DoubleSlider(113, range=0..121 step 1)  # graph input
변수3 = DoubleSlider(47, range=0..121 step 1)  # graph input
변수4 = DoubleSlider(61, range=0..121 step 1)  # graph input

# group: POINT를 변수로 랜덤하게 선택
flatten_3 = List.Flatten(list=intersect_5)
shuffle = List.Shuffle(list=flatten_3, seed=변수1)
shuffle_2 = List.Shuffle(list=flatten_3, seed=변수2)
shuffle_3 = List.Shuffle(list=flatten_3, seed=변수3)
shuffle_4 = List.Shuffle(list=flatten_3, seed=변수4)

# group: 건축 가능 범위
perimeterCurves = Surface.PerimeterCurves(surface=difference)
byJoinedCurves = PolyCurve.ByJoinedCurves(curves=perimeterCurves)
watch_4 = Watch(byJoinedCurves)

# group: 배치 변수 Point에 공간 이동
X = Point.X(point=shuffle)
Y = Point.Y(point=shuffle)
translate = Geometry.Translate(geometry=byPatch, xTranslation=X, yTranslation=Y)
doesIntersect = Geometry.DoesIntersect(geometry=watch_4, other=translate, lacing=Longest)
filterByBoolMask = List.FilterByBoolMask(list=shuffle, mask=doesIntersect)
firstItem_3 = List.FirstItem(list=filterByBoolMask.out)
X_2 = Point.X(point=firstItem_3)
Y_2 = Point.Y(point=firstItem_3)
translate_2 = Geometry.Translate(geometry=byPatch, xTranslation=X_2, yTranslation=Y_2)
X_3 = Point.X(point=shuffle_2)
Y_3 = Point.Y(point=shuffle_2)
translate_3 = Geometry.Translate(geometry=byPatch_2, xTranslation=X_3, yTranslation=Y_3)
doesIntersect_2 = Geometry.DoesIntersect(geometry=watch_4, other=translate_3, lacing=Longest)
filterByBoolMask_2 = List.FilterByBoolMask(list=shuffle_2, mask=doesIntersect_2)
lastItem = List.LastItem(list=filterByBoolMask_2.out)
X_4 = Point.X(point=lastItem)
Y_4 = Point.Y(point=lastItem)
translate_4 = Geometry.Translate(geometry=byPatch_2, xTranslation=X_4, yTranslation=Y_4)
X_5 = Point.X(point=shuffle_3)
Y_5 = Point.Y(point=shuffle_3)
translate_5 = Geometry.Translate(geometry=byPatch_3, xTranslation=X_5, yTranslation=Y_5)
doesIntersect_3 = Geometry.DoesIntersect(geometry=watch_4, other=translate_5, lacing=Longest)
filterByBoolMask_3 = List.FilterByBoolMask(list=shuffle_3, mask=doesIntersect_3)
lastItem_2 = List.LastItem(list=filterByBoolMask_3.out)
X_6 = Point.X(point=lastItem_2)
Y_6 = Point.Y(point=lastItem_2)
translate_6 = Geometry.Translate(geometry=byPatch_3, xTranslation=X_6, yTranslation=Y_6)
X_7 = Point.X(point=shuffle_4)
Y_7 = Point.Y(point=shuffle_4)
translate_7 = Geometry.Translate(geometry=byPatch_4, xTranslation=X_7, yTranslation=Y_7)
doesIntersect_4 = Geometry.DoesIntersect(geometry=watch_4, other=translate_7, lacing=Longest)
filterByBoolMask_4 = List.FilterByBoolMask(list=shuffle_4, mask=doesIntersect_4)
lastItem_3 = List.LastItem(list=filterByBoolMask_4.out)
X_8 = Point.X(point=lastItem_3)
Y_8 = Point.Y(point=lastItem_3)
translate_8 = Geometry.Translate(geometry=byPatch_4, xTranslation=X_8, yTranslation=Y_8)

# group: 배치 영역 결합
join_5 = List.Join(list0=translate_2, list1=translate_4, list2=translate_6, list3=translate_8)
byJoinedSurfaces_2 = PolySurface.ByJoinedSurfaces(surfaces=join_5)

# group: 건축면적
area = Surface.Area(surface=byJoinedSurfaces_2)
code_block_4 = CodeBlock(a=area) { a/100000; }
round = Math.Round(number=code_block_4)
건축면적_m2 = List.FirstItem(list=round)  # graph output

# group: 대지면적
area_2 = Surface.Area(surface=byPatch_5)
code_block_5 = CodeBlock(a=area_2) { a/100000; }
round_2 = Math.Round(number=code_block_5)
대지면적 = List.FirstItem(list=round_2)

# group: 건폐율
code_block_6 = CodeBlock(건축면적=건축면적_m2, 대지면적=대지면적) { 건축면적/대지면적*100; }
건폐율 = List.FirstItem(list=code_block_6)  # graph output

# group: 건폐율 충족
건폐율_30다_작으면_다시 = CodeBlock(a=code_block_6) { a<40; }
code_block_7 = CodeBlock { 1; 0; }
if_ = RefactoredIf(test=건폐율_30다_작으면_다시, true=code_block_7.out0, false=code_block_7.out1)
건폐율_충족_1 = List.FirstItem(list=if_)  # graph output

# group: 정북일조
byStartPointEndPoint_3 = Line.ByStartPointEndPoint(startPoint=byCoordinates_3, endPoint=byCoordinates_4)
startPoint = Curve.StartPoint(curve=byStartPointEndPoint_3)
X_9 = Point.X(point=startPoint)
Y_9 = Point.Y(point=startPoint)
byCoordinates_7 = Point.ByCoordinates(x=X_9, y=Y_9)
code_block_8 = CodeBlock { 9000; }
translate_9 = Geometry.Translate(geometry=byCoordinates_7, zTranslation=code_block_8)
code_block_9 = CodeBlock { -4500; }
translate_10 = Geometry.Translate(geometry=translate_9, yTranslation=code_block_9)
code_block_10 = CodeBlock { -20000; }
translate_11 = Geometry.Translate(geometry=translate_10, yTranslation=code_block_10)
code_block_11 = CodeBlock(a=code_block_10) { -(a*2); }
translate_12 = Geometry.Translate(geometry=translate_11, zTranslation=code_block_11)
byStartPointEndPoint_4 = Line.ByStartPointEndPoint(startPoint=translate_10, endPoint=translate_12)
byStartPointEndPoint_5 = Line.ByStartPointEndPoint(startPoint=translate_9, endPoint=translate_10)
byStartPointEndPoint_6 = Line.ByStartPointEndPoint(startPoint=byCoordinates_7, endPoint=translate_9)
list_create = List.Create(item0=byCoordinates_7, item1=translate_9, item2=translate_10, item3=translate_12)
byPoints_4 = PolyCurve.ByPoints(points=list_create)
code_block_12 = CodeBlock(정북일조라인=byStartPointEndPoint_3) { 정북일조라인; }
bySweep = Surface.BySweep(profile=byPoints_4, path=code_block_12)
code_block_13 = CodeBlock { -100000; }
boolean_2 = BoolSelector(false)
thicken = Surface.Thicken(surface=bySweep, thickness=code_block_13, both_sides=boolean_2)
byUnion = Solid.ByUnion(solids=thicken)

# group: 환경성능 (남+북 길이 합 / 동+서 길이합)
code_block_14 = CodeBlock {  }
code_block_15 = CodeBlock {  }

# group: 공간 배치 Solid
code_block_16 = CodeBlock { 1000; }
boolean_3 = BoolSelector(false)
thicken_2 = Surface.Thicken(surface=translate_2, thickness=code_block_16, both_sides=boolean_3)
thicken_3 = Surface.Thicken(surface=translate_4, thickness=code_block_16, both_sides=boolean_3)
thicken_4 = Surface.Thicken(surface=translate_6, thickness=code_block_16, both_sides=boolean_3)
thicken_5 = Surface.Thicken(surface=translate_8, thickness=code_block_16, both_sides=boolean_3)

# group: 건축면적 > 매스 수
join_6 = List.Join(list0=thicken_2, list1=thicken_3, list2=thicken_4, list3=thicken_5)
byUnion_2 = Solid.ByUnion(solids=join_6)
separate = Solid.Separate(solid=byUnion_2)
매스수 = List.Count(list=separate)  # graph output
watch_5 = Watch(매스수)

# group: 남북, 동서 길이 추출을 위한 CURVE 분리
explode = Geometry.Explode(geometry=separate)
code_block_17 = CodeBlock { 0.5; }
normalAtParameter = Surface.NormalAtParameter(surface=explode, u=code_block_17, v=code_block_17)
Z = Vector.Z(vector=normalAtParameter)
code_block_18 = CodeBlock { -1; }
eq = Z == code_block_18
filterByBoolMask_5 = List.FilterByBoolMask(list=explode, mask=eq)
flatten_4 = List.Flatten(list=filterByBoolMask_5.in)
perimeterCurves_2 = Surface.PerimeterCurves(surface=flatten_4)
startPoint_2 = Curve.StartPoint(curve=perimeterCurves_2)
endPoint = Curve.EndPoint(curve=perimeterCurves_2)
byTwoPoints = Vector.ByTwoPoints(start=startPoint_2, end=endPoint)
normalized = Vector.Normalized(vector=byTwoPoints)
X_10 = Vector.X(vector=normalized)
code_block_19 = CodeBlock { 0; }
eq_2 = X_10 == code_block_19
filterByBoolMask_6 = List.FilterByBoolMask(list=perimeterCurves_2, mask=eq_2)

# group: 환경성능 , 전체 둘레
flatten_5 = List.Flatten(list=filterByBoolMask_6.out)
length_3 = Curve.Length(curve=flatten_5)
남_북 = Math.Sum(values=length_3)
flatten_6 = List.Flatten(list=filterByBoolMask_6.in)
length_4 = Curve.Length(curve=flatten_6)
동_서 = Math.Sum(values=length_4)
code_block_20 = CodeBlock(남북=남_북, 동서=동_서) { 남북/동서; }
환경성능 = List.FirstItem(list=code_block_20)  # graph output
code_block_21 = CodeBlock(남북=남_북, 동서=동_서) { (남북+동서)/1000; }
전체둘레_m = List.FirstItem(list=code_block_21)  # graph output

# group: 층수, 층고
층수 = IntegerSlider(11, range=5..15 step 1)  # graph input
층고 = DoubleInput(3000)
code_block_22 = CodeBlock(층수=층수, 층고=층고) { 0..층수*층고..층고; }

# group: 정북일조 제외 영역 SURFACE
translate_13 = Geometry.Translate(geometry=byJoinedSurfaces_2, zTranslation=code_block_22)
explode_2 = Geometry.Explode(geometry=translate_13)
정북일조_solid = Watch(byUnion)
subtractFrom = Surface.SubtractFrom(surface=explode_2, trimmingEntity=정북일조_solid)
flatten_7 = List.Flatten(list=subtractFrom)

# group: 정북일조 제외 영역 SOLID , 층고 대입
boolean_4 = BoolSelector(false)
thicken_6 = Surface.Thicken(surface=explode_2, thickness=층고, both_sides=boolean_4)
byUnion_3 = Solid.ByUnion(solids=thicken_6)
differenceAll = Solid.DifferenceAll(solid=byUnion_3, others=정북일조_solid)

# group: 연면적
area_3 = Surface.Area(surface=flatten_7)
code_block_23 = CodeBlock(a=area_3) { a/100000; }
round_3 = Math.Round(number=code_block_23)
연면적 = Math.Sum(values=round_3)  # graph output

# group: 용적률
code_block_24 = CodeBlock(연면적=연면적, 대지면적=대지면적) { 연면적/대지면적*100; }
용적률 = List.FirstItem(list=code_block_24)  # graph output

# group: 정북일조 제외 영역 층 확인 SOLID
thicken_7 = Surface.Thicken(surface=explode_2)
byUnion_4 = Solid.ByUnion(solids=thicken_7)
differenceAll_2 = Solid.DifferenceAll(solid=byUnion_4, others=정북일조_solid)

# group: 형태 색상 지정
code_block_25 = CodeBlock { 200; 200; }
byARGB = Color.ByARGB(alpha=code_block_25.out0, red=code_block_25.out1, green=code_block_25.out1, blue=code_block_25.out1)
byGeometryColor = Modifiers.GeometryColor.ByGeometryColor(geometry=differenceAll, color=byARGB)
code_block_26 = CodeBlock { 250; 200; }
byARGB_2 = Color.ByARGB(alpha=code_block_26.out0, red=code_block_26.out1, green=code_block_26.out1)
byGeometryColor_2 = Modifiers.GeometryColor.ByGeometryColor(geometry=differenceAll_2, color=byARGB_2)
